# Grasshopper definition GSX2JSON-tutorial.ghx (Grasshopper 1.0.8)

gsheets2api = Python3Script()  # -> out, cols, rows
# ---------- gsheets2api: Python ----------
import os
import sys

def _find_gh_doc_path():
    """
    Try multiple ways to get the current Grasshopper document file path.
    Returns: full path to .gh/.ghx or None
    """
    # 1) Grasshopper Python usually injects a 'ghdoc' object
    try:
        import Grasshopper as GH
        # If ghdoc exists, it often has a Path property
        if 'ghdoc' in globals():
            p = getattr(ghdoc, "Path", None)
            if p:
                return p
        # Fallback: active canvas document
        doc = GH.Instances.ActiveCanvas.Document
        p = getattr(doc, "FilePath", None) or getattr(doc, "Path", None)
        if p:
            return p
    except Exception:
        pass

    return None


def _project_root():
    """
    Determine project root (folder containing model.ghx and .venv).
    """
    gh_path = _find_gh_doc_path()
    if gh_path and os.path.isfile(gh_path):
        return os.path.dirname(gh_path)

    # Fallback 1: current working directory (sometimes equals doc dir)
    cwd = os.getcwd()
    if os.path.isdir(os.path.join(cwd, ".venv")):
        return cwd

    # Fallback 2: walk up from cwd until we find .venv (max a few levels)
    cur = cwd
    for _ in range(6):
        if os.path.isdir(os.path.join(cur, ".venv")):
            return cur
        parent = os.path.dirname(cur)
        if parent == cur:
            break
        cur = parent

    raise RuntimeError("Could not locate project root (.venv not found).")


def _venv_site_packages(root):
    """
    Compute venv site-packages path for Windows or macOS.
    """
    # Windows
    win = os.path.join(root, ".venv", "Lib", "site-packages")
    if os.path.isdir(win):
        return win

    # macOS / Linux layout: .venv/lib/python3.X/site-packages
    lib = os.path.join(root, ".venv", "lib")
    if os.path.isdir(lib):
        # Find python3.X folder dynamically
        for name in os.listdir(lib):
            if name.startswith("python3") and os.path.isdir(os.path.join(lib, name, "site-packages")):
                return os.path.join(lib, name, "site-packages")

    raise RuntimeError("Could not locate .venv site-packages.")


root = _project_root()
site = _venv_site_packages(root)

if site not in sys.path:
    sys.path.insert(0, site)

# now imports resolve from your project venv
import numpy as np
import pandas as pd
import requests

# Source: https://docs.google.com/spreadsheets/d/1H3kjJ-HJ3AvZKDr39ck7iKPAL7yumozkZIHQDZATCJQ

from Grasshopper import DataTree
from Grasshopper.Kernel.Data import GH_Path

url = "https://opensheet.elk.sh/1H3kjJ-HJ3AvZKDr39ck7iKPAL7yumozkZIHQDZATCJQ/1"
r = requests.get(url, timeout=5)
r.raise_for_status()

df = pd.DataFrame(r.json())

# DataFrame output
a = df

# Column names
cols = df.columns.tolist()

# Grasshopper-friendly table output (tree: one branch per row)
rows_tree = DataTree[object]()
for i, row in enumerate(df.itertuples(index=False, name=None)):
    p = GH_Path(i)
    for v in row:
        rows_tree.Add(v, p)
rows = rows_tree

# Optional: panel-friendly strings
rows_text = [" | ".join(map(str, row)) for row in df.itertuples(index=False, name=None)]
# ---------- end gsheets2api ----------
simplify = SimplifyTree(Tree=gsheets2api.rows, Front=False)
panel = Panel(gsheets2api.cols)
branch = TreeBranch(Tree=simplify, Path=Slider(0, range=0..10), MaintainPaths=True)
panel_2 = Panel(branch)
